# Grasshopper definition GeodesicGridshellWorkshopChalmersUniversity.gh (Grasshopper 0.9.76)
# plug-ins: LunchBox

# ---- group: Reference surface from Rhino due to stupid patch in grasshopper
srf = Surface(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)
srf_2 = Surface(srf)

# ---- group: Idealized Boundary CUrves
base_curves = Curve([<curve referenced from the Rhino model> x4])
item = ListItem(List=base_curves, Index=0, Wrap=True)

# ---- group: Surface Generation
# This code was written by Isak Näslund, Emil Adiels, Nicolo Bencini, Emil Poulsen, Puria Safari and Cecilie Brandt-Olsen for the Geodesic Gridshell workshop at Chalmers University of Technology in 2017.
# 
# Video from the workshop
# https://www.youtube.com/watch?v=cTRvXiK9dK8
construction_curves = Line([Line((13.00062847, -8.999342543, 0.002062816608), (13.0012611, -8.892536348, 0.2494327564)), Line((13.00062847, -8.999342543, 0.002062816608), (13.25146092, -8.907332726, 0.002153734131)), Line((13.0012611, -8.892536348, 0.2494327564), (13.00127252, -8.785496285, 0.4824108439)), Line((13.00127252, -8.785496285, 0.4824108439), (13.00127485, -8.678430989, 0.7002004132)), Line((13.00127485, -8.678430989, 0.7002004132), (13.00127642, -8.571349928, 0.9023400512)), Line((13.00127642, -8.571349928, 0.9023400512), (13.00127865, -8.464256726, 1.088501711))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])
end = EndPoints(Curve=construction_curves)  # -> Start, End
cullpt = CullDuplicates(Points=[end.Start, end.End], Tolerance=Slider(0.001, range=0..0.001), CullMode=3)  # -> Points, Indices, Valence
patch = Patch(
    Curves=construction_curves,
    Points=cullpt.Points,
    Spans=Slider(40, range=0..100),
    Flexibility=Slider(0.5, range=0..1),
    Trim=False)
bbox = BoundingBox(Content=construction_curves, Plane=PlaneXY(0, 0, 0), UnionBox=True)  # -> Box, Box_2
tight_bounding_box = Box(bbox.Box)
tight_bounding_box_2 = Box(tight_bounding_box)
inflate = CSharpScript(x=tight_bounding_box_2, y=Slider(0.05, range=0..0.1))  # -> out, A; inputs x: Box, y: Double
# ---------- inflate: C# ----------
    x.Inflate(y, y, 0);
    x.Z = new Interval(0, x.Z.Max);
    A = x;
# ---------- end inflate ----------
expanded_bounding_box_bounding_box = Box(inflate.A)

# ----
# Input
centre_point = Point(Point(18.5, -7.5, 0))

# ----
# Input Controlls
number_of_strips_1_for_symmetry = Panel("7")
boundary_divisions = Integer(number_of_strips_1_for_symmetry)

# ---- group: Surface-xy plane cutting curves
crv = Curve([<curve referenced from the Rhino model> x4])

# ----
# Angle Brackets data
number_slider = Slider(0.026, range=0..0.1)
height_hole_angle = Number(number_slider)
width_angle = Number(Slider(0.035, range=0..0.1))
length_angle = Number(Slider(0.05, range=0..0.1))
thickness_angle = Number(Slider(0.003, range=0..0.1))

width_strips = Number(Slider(0.05, range=0..1))
thickness_plywood = Number(Slider(0.006, range=0..0.01))
strip_overlap = Number(Slider(0.1, range=0..0.1))
bolt_hole_radius = Number(Slider(0.003, range=0..0.01))
boundary_elongation = Number(Slider(0.1, range=0..0.1))
max_length_plywood = Number(Slider(2.4, range=0..10))
thickness_boundary = Number(Slider(0.024, range=0..0.1))
width_boundary = Number(Slider(0.2, range=0..1))
boundary_faster_hole_diameter = Number(Slider(0.046, range=0..0.1))

pi = Pi(Factor=Slider(0.5, range=0..1))
series = Series(Start=0, Step=pi, Count=Slider(4, range=0..10))
rotation_angles = Number(series)

# ----
# Geodesic angles
number_slider_2 = Slider(10, range=0..90)
rad = Radians(Degrees=Slider(0, range=0..90))
rad_2 = Radians(Degrees=Slider(1.7, range=0..10))
rad_3 = Radians(Degrees=Slider(3, range=0..90))
rad_4 = Radians(Degrees=Slider(5, range=0..90))
rad_5 = Radians(Degrees=Slider(5, range=0..90))
rad_6 = Radians(Degrees=number_slider_2)
rad_7 = Radians(Degrees=Slider(15, range=0..90))
rad_8 = Radians(Degrees=Slider(10, range=0..90))

# ----
# Divide Curves
boundary_divisions_2 = Integer(boundary_divisions)
crv_2 = Curve(reparameterize(item))
shatter = Shatter(Curve=crv_2, Parameters="0.5")
number_slider_3 = Slider(0.01, range=0..0.1)
one_over_x = OneOverX(Value=boundary_divisions_2)
division = Division(A=one_over_x, B=2)
item_2 = ListItem(List=shatter, Index=0, Wrap=True)  # -> Item, Item1
dom = ConstructDomain(DomainStart=division, DomainEnd=Slider(1, range=0..1))
addition = Addition(A=division, B=number_slider_3)
flip = FlipCurve(Curve=item_2.Item)  # -> Curve, Flag
number_slider_4 = Slider(1, range=0..1)
range = Range(Domain=dom, Steps=boundary_divisions_2)
item_3 = ListItem(List=range, Index=boundary_divisions_2, Wrap=True)
subtraction = Subtraction(A=item_3, B=Slider(0.02, range=0..0.1))
merge = Merge(Data1=flip.Curve, Data2=item_2.Item1)  # -> simplify(graft(Result))
replace = ReplaceItems(List=range, Item=subtraction, Indices=boundary_divisions_2, Wrap=False)
item_4 = ListItem(List=replace, Index=number_slider_4, Wrap=True)
addition_2 = Addition(A=item_4, B=number_slider_3)
replace_2 = ReplaceItems(List=replace, Item=addition_2, Indices=number_slider_4, Wrap=False)
num = Number(replace_2)
eval = EvaluateCurve(Curve=reparameterize(merge), Parameter=num)  # -> Point, Tangent, Angle
Z = UnitZ(Factor=1)
expanded_bounding_box_bounding_box_2 = Box(expanded_bounding_box_bounding_box)
eval_2 = EvaluateCurve(Curve=reparameterize(flip.Curve), Parameter=num)  # -> Point, Tangent, Angle
crv_3 = Curve(crv)
neg = Negative(Value=Z)
srf_cp = SurfaceClosestPoint(Point=eval_2.Point, Surface=srf_2)  # -> Point, UVPoint, Distance
move = Move(Geometry=expanded_bounding_box_bounding_box_2, Motion=neg)  # -> Geometry, Transform
evalsrf = EvaluateSurface(Surface=srf_2, Point=srf_cp.UVPoint)  # -> Point, Normal, Frame
trim = TrimWithBrep(Curve=crv_3, Brep=move.Geometry)  # -> Inside, Outside
crv_4 = Curve(flatten(trim.Inside))
xprod = CrossProduct(VectorA=evalsrf.Normal, VectorB=eval_2.Tangent, Unitize=False)  # -> Vector, Length
crv_cp = CurveClosestPoint(Point=graft(eval.Point), Curve=crv_4)  # -> Point, Parameter, Distance
neg_2 = Negative(Value=xprod.Vector)
vdis = VectorDisplay(Anchor=evalsrf.Point, Vector=neg_2)
sort = SortList(Keys=crv_cp.Distance, ValuesA=crv_cp.Point)  # -> Keys, ValuesA
# Generate the geodesic pattern
# Geodesic Control Panel
item_5 = ListItem(List=sort.ValuesA, Index=0, Wrap=True)

# ----
# Instructions: 1.  Set "Target Path" to a rhino curve.  This is the path along which the camera's target will move.
# 
# 2. Set "Camera Path" to a rhino curve.  This is the path along which the camera itself will move.
# 
# 3. Set the total number of frames
# 
# 4. Enable the Camera button.  It will move the active view in Rhino to the correct position along the camera path.
# 
# 5. Run the animation by animating the Animation Slider (right-click on it).
# Graph Mapper: The graph mapper basically slows the camera down at the beginning and end of the animation
animation_slider = Slider(200, range=0..200)
total_number_of_frames = Slider(200, range=0..200)
target_path = Curve(<curve referenced from the Rhino model>)
camera_path = Curve(<curve referenced from the Rhino model>)
frames = Receiver(total_number_of_frames)
dom_2 = Domain(DomainStart=0, DomainEnd=1)
range_2 = Range(Domain=dom_2, Steps=frames)
camera_path_2 = Receiver(camera_path)
graph = GraphMapper(
    range_2,
    x0=0,
    x1=1,
    y0=0,
    y1=1,
    A=1.52499997,
    B=0.4,
    container_name="Linear",
    Graph_x0=0.1475409865,
    Graph_x1=0.3934426308,
    Graph_y0=0.625,
    Graph_y1=1)
domcomp = DomainComponents(Domain=camera_path_2)  # -> Start, End
multiplication = Multiplication(A=domcomp.End, B=graph)
target_path_2 = Receiver(target_path)
frames_2 = Receiver(total_number_of_frames)
eval_3 = EvaluateCurve(Curve=camera_path_2, Parameter=multiplication)  # -> Point, Tangent, Length
frame_number = Receiver(animation_slider)
divide = DivideCurve(Curve=target_path_2, Number=expr("x-1", frames_2), Kinks=False)  # -> Points, Tangents, Parameters
item_6 = ListItem(List=eval_3.Point, Index=expr("x-1", frame_number), Wrap=False)
item_7 = ListItem(List=divide.Points, Index=expr("x-1", frame_number), Wrap=False)
vcomp = Decompose(Vector=eval_3.Tangent)  # -> XComponent, YComponent, ZComponent
vec = VectorXYZ(XComponent=0, YComponent=vcomp.YComponent, ZComponent=vcomp.ZComponent)  # -> Vector, Length
camera = CSharpScript(location=item_6, target=item_7, upVector=vec.Vector)  # -> out, A; inputs location: Point3d, target: Point3d, upVector: Vector3d
# ---------- camera: C# ----------
    Rhino.Display.RhinoView view = doc.Views.ActiveView;

    Rhino.Display.RhinoViewport vp = view.ActiveViewport;

    vp.CameraUp = upVector;
    vp.SetCameraLocation(location, false);
    vp.SetCameraDirection(target - location, true);
# ---------- end camera ----------

item_8 = ListItem(List=xprod.Vector, Index=0, Wrap=True)  # -> Item, Item1, Item2, Item3, Item4, Item5, Item6, Item7

amp = Amplitude(Vector=item_8.Item7, Amplitude=Slider(0.02, range=0..1))
amp_2 = Amplitude(Vector=item_8.Item, Amplitude=Slider(0.01, range=0..1))
amp_3 = Amplitude(Vector=item_8.Item1, Amplitude=Slider(0.01, range=0..1))
amp_4 = Amplitude(Vector=item_8.Item3, Amplitude=Slider(0.01, range=0..1))
amp_5 = Amplitude(Vector=item_8.Item4, Amplitude=Slider(0.01, range=0..1))
amp_6 = Amplitude(Vector=item_8.Item5, Amplitude=Slider(0.01, range=0..1))
amp_7 = Amplitude(Vector=item_8.Item6, Amplitude=Slider(0.01, range=0..1))
amp_8 = Amplitude(Vector=item_8.Item2, Amplitude=Slider(0.003, range=0..1))

item_9 = ListItem(List=evalsrf.Point, Index=0, Wrap=True)  # -> Item, Item1, Item2, Item3, Item4, Item5, Item6, Item7
move_2 = Move(Geometry=item_9.Item, Motion=amp_2)  # -> Geometry, Transform
move_3 = Move(Geometry=item_9.Item1, Motion=amp_3)  # -> Geometry, Transform
move_4 = Move(Geometry=item_9.Item2, Motion=amp_8)  # -> Geometry, Transform
move_5 = Move(Geometry=item_9.Item3, Motion=amp_4)  # -> Geometry, Transform
move_6 = Move(Geometry=item_9.Item4, Motion=amp_5)  # -> Geometry, Transform
move_7 = Move(Geometry=item_9.Item5, Motion=amp_6)  # -> Geometry, Transform
move_8 = Move(Geometry=item_9.Item6, Motion=amp_7)  # -> Geometry, Transform
move_9 = Move(Geometry=item_9.Item7, Motion=amp)  # -> Geometry, Transform

item_10 = ListItem(List=evalsrf.Frame, Index=0, Wrap=True)  # -> Item, Item1, Item2, Item3, Item4, Item5, Item6, Item7

rotate = Rotate(Geometry=move_2.Geometry, Angle=rad, Plane=item_10.Item)  # -> Geometry, Transform
srf_cp_2 = SurfaceClosestPoint(Point=rotate.Geometry, Surface=srf)  # -> flatten(Point), UVPoint, Distance

rotate_2 = Rotate(Geometry=move_3.Geometry, Angle=rad_2, Plane=item_10.Item1)  # -> Geometry, Transform
srf_cp_3 = SurfaceClosestPoint(Point=rotate_2.Geometry, Surface=srf)  # -> flatten(Point), UVPoint, Distance

rotate_3 = Rotate(Geometry=move_4.Geometry, Angle=rad_3, Plane=item_10.Item2)  # -> Geometry, Transform
srf_cp_4 = SurfaceClosestPoint(Point=rotate_3.Geometry, Surface=srf)  # -> flatten(Point), UVPoint, Distance

rotate_4 = Rotate(Geometry=move_5.Geometry, Angle=rad_4, Plane=item_10.Item3)  # -> Geometry, Transform
srf_cp_5 = SurfaceClosestPoint(Point=rotate_4.Geometry, Surface=srf)  # -> flatten(Point), UVPoint, Distance

rotate_5 = Rotate(Geometry=move_6.Geometry, Angle=rad_5, Plane=item_10.Item4)  # -> Geometry, Transform
srf_cp_6 = SurfaceClosestPoint(Point=rotate_5.Geometry, Surface=srf)  # -> flatten(Point), UVPoint, Distance

rotate_6 = Rotate(Geometry=move_7.Geometry, Angle=rad_6, Plane=item_10.Item5)  # -> Geometry, Transform
srf_cp_7 = SurfaceClosestPoint(Point=rotate_6.Geometry, Surface=srf)  # -> flatten(Point), UVPoint, Distance

rotate_7 = Rotate(Geometry=move_8.Geometry, Angle=rad_7, Plane=item_10.Item6)  # -> Geometry, Transform
srf_cp_8 = SurfaceClosestPoint(Point=rotate_7.Geometry, Surface=srf)  # -> flatten(Point), UVPoint, Distance

rotate_8 = Rotate(Geometry=move_9.Geometry, Angle=rad_8, Plane=item_10.Item7)  # -> Geometry, Transform
srf_cp_9 = SurfaceClosestPoint(Point=rotate_8.Geometry, Surface=srf)  # -> flatten(Point), UVPoint, Distance

pt = Point(srf_cp_2.Point)
pt_2 = Point(srf_cp_3.Point)
pt_3 = Point(srf_cp_4.Point)
pt_4 = Point(srf_cp_6.Point)
pt_5 = Point(srf_cp_7.Point)
pt_6 = Point(srf_cp_5.Point)
pt_7 = Point(srf_cp_8.Point)
pt_8 = Point(srf_cp_9.Point)

pt_9 = Point(flatten(item_5))
item_11 = ListItem(List=pt_9, Index=0, Wrap=True)  # -> Item, Item1, Item2, Item3, Item4, Item5, Item6, Item7, Item8

# ----
# Create Geodesics
toggle = BooleanToggle(False)

geodesics = CSharpScript(
    divPoint=simplify(flatten(item_11.Item1)),
    pt2=simplify(flatten(pt_2)),
    surf=srf_2,
    flip=toggle,
    num=Slider(2000, range=0..10000))  # -> out, ptsGeodesics, circles; inputs divPoint: list of Point3d, pt2: list of Point3d, surf: Surface, flip: Boolean, num: Int32
# ---------- geodesics: C# ----------
    List<Point3d> ptOut;
    List<Point3d> ptNew = new List<Point3d>();
    List<Curve> crvNew = new List<Curve>();
    DataTree<Point3d> myTree = new DataTree<Point3d>();
    DataTree<Curve> myTree2 = new DataTree<Curve>();

    ptOut = pt2;
    ptNew = divPoint;

    GH_Path pth;
    Point3d p1;
    Point3d p2;
    Point3d p4;
    Curve circle;

    for (int i = 0; i < ptOut.Count; i++)
    {
      pth = new GH_Path(i);
      myTree.Add(ptNew[i], pth);
      myTree.Add(ptOut[i], pth);

      for (int j = 0; j < num; j++)
      {
        p1 = myTree[pth, j];
        p2 = myTree[pth, j + 1];
        if(Inter(surf, p1, p2, out p4, out circle))
        {
          myTree.Add(p4, pth);
          myTree2.Add(circle, pth);
        }
        else
          break;
      }

    }



    ptsGeodesics = myTree;
    circles = myTree2;
# ---------- geodesics: C# additional code ----------
  public bool InitPoints(Curve c, List<Point3d> pt, Surface s, double distance, bool flip, out List<Point3d> ptOut, out List<Curve> crvOut, out List<bool> boolen)
  {

    Curve circle;
    Curve cCurve;
    List<Curve> circles = new List <Curve>();
    List<bool> flag = new List <bool>();
    Vector3d tan, normal,cross;
    double t;
    double u,v;
    Plane p;
    Brep b = s.ToBrep();
    Circle circ;
    Curve[] overlap_curves;
    Point3d[] inter_points;
    int f = 1;
    if(flip)
      f = -1;

    List<Point3d> ptInter = new List<Point3d>();
    for (int i = 0; i < pt.Count; i++)
    {
      c.ClosestPoint(pt[i], out t);
      tan = c.TangentAt(t);
      s.ClosestPoint(pt[i], out u, out v);
      normal = s.NormalAt(u, v);
      cross = Vector3d.CrossProduct(tan, normal);
      p = new Plane(pt[i], normal, cross);

      circ = new Circle(p, pt[i], distance);
      cCurve = circ.ToNurbsCurve();
      circle = cCurve;
      circles.Add(cCurve);

      Rhino.Geometry.Intersect.Intersection.CurveBrep(cCurve, b, 0.001, out overlap_curves, out inter_points);
      if(inter_points.Length == 1)
        ptInter.Add(inter_points[0]);
      if(inter_points.Length == 2)
      {
        Point3d pTest = cross * f + pt[i];
        if(inter_points[0].DistanceTo(pTest) < inter_points[1].DistanceTo(pTest))
          ptInter.Add(inter_points[0]);
        else
          ptInter.Add(inter_points[1]);
      }
      if(inter_points.Length == 0)
        flag.Add(false);
      else
        flag.Add(true);


    }

    ptOut = ptInter;
    crvOut = circles;

    boolen = flag;
    return true;

  }

  public bool Inter(Surface s, Point3d p1, Point3d p2, out Point3d p4, out Curve circle)
  {

    Point3d p3;

    double tolerance = 0.001;
    Curve[] overlap_curves;
    Point3d[] inter_points;
    double u,v;
    Vector3d normal;
    s.ClosestPoint(p2, out u, out v);
    Point3d closPt = s.PointAt(u, v);
    normal = s.NormalAt(u, v);
    Vector3d dir = p2 - p1;
    //Vector3d cross = Vector3d.CrossProduct(dir, normal);

    //Plane p = new Plane(closPt, cross);
    Plane p = new Plane(closPt, dir, normal);
    Circle circ = new Circle(p, p.Origin, dir.Length);
    Curve cCurve = circ.ToNurbsCurve();
    circle = cCurve;
    Brep b = s.ToBrep();


    Rhino.Geometry.Intersect.Intersection.CurveBrep(cCurve, b, tolerance, out overlap_curves, out inter_points);

    if(inter_points.Length < 2)
    {
      p4 = new Point3d(1, 1, 1);
      return false;
    }


    if(inter_points[0].DistanceTo(p1) < inter_points[1].DistanceTo(p1))
    {
      p3 = inter_points[1];
    }
    else
    {
      p3 = inter_points[0];
    }

    p4 = p3;
    return  true;

  }
# ---------- end geodesics ----------

geodesics_2 = CSharpScript(
    divPoint=simplify(flatten(item_11.Item7)),
    pt2=simplify(flatten(pt_8)),
    surf=srf_2,
    flip=toggle,
    num=Slider(400, range=0..1000))  # -> out, ptsGeodesics, circles; inputs divPoint: list of Point3d, pt2: list of Point3d, surf: Surface, flip: Boolean, num: Int32; same code as geodesics

geodesics_3 = CSharpScript(
    divPoint=simplify(flatten(item_11.Item3)),
    pt2=simplify(flatten(pt_6)),
    surf=srf_2,
    flip=toggle,
    num=Slider(350, range=0..1000))  # -> out, ptsGeodesics, circles; inputs divPoint: list of Point3d, pt2: list of Point3d, surf: Surface, flip: Boolean, num: Int32; same code as geodesics

geodesics_4 = CSharpScript(
    divPoint=simplify(flatten(item_11.Item4)),
    pt2=simplify(flatten(pt_4)),
    surf=srf_2,
    flip=toggle,
    num=Slider(350, range=0..1000))  # -> out, ptsGeodesics, circles; inputs divPoint: list of Point3d, pt2: list of Point3d, surf: Surface, flip: Boolean, num: Int32; same code as geodesics

geodesics_5 = CSharpScript(
    divPoint=simplify(flatten(item_11.Item2)),
    pt2=simplify(flatten(pt_3)),
    surf=srf_2,
    flip=toggle,
    num=Slider(2000, range=0..10000))  # -> out, ptsGeodesics, circles; inputs divPoint: list of Point3d, pt2: list of Point3d, surf: Surface, flip: Boolean, num: Int32; same code as geodesics

geodesics_6 = CSharpScript(
    divPoint=simplify(flatten(item_11.Item5)),
    pt2=simplify(flatten(pt_5)),
    surf=srf_2,
    flip=toggle,
    num=Slider(300, range=0..1000))  # -> out, ptsGeodesics, circles; inputs divPoint: list of Point3d, pt2: list of Point3d, surf: Surface, flip: Boolean, num: Int32; same code as geodesics

geodesics_7 = CSharpScript(
    divPoint=simplify(flatten(item_11.Item6)),
    pt2=simplify(flatten(pt_7)),
    surf=srf_2,
    flip=toggle,
    num=Slider(400, range=0..1000))  # -> out, ptsGeodesics, circles; inputs divPoint: list of Point3d, pt2: list of Point3d, surf: Surface, flip: Boolean, num: Int32; same code as geodesics

geodesics_8 = CSharpScript(
    divPoint=simplify(flatten(item_11.Item)),
    pt2=simplify(flatten(pt)),
    surf=srf_2,
    flip=toggle,
    num=Slider(500, range=0..1000))  # -> out, ptsGeodesics, circles; inputs divPoint: list of Point3d, pt2: list of Point3d, surf: Surface, flip: Boolean, num: Int32; same code as geodesics

entwine = Entwine(
    Branch00=geodesics_8.ptsGeodesics,
    Branch01=geodesics.ptsGeodesics,
    Branch02=geodesics_5.ptsGeodesics,
    Branch03=geodesics_3.ptsGeodesics,
    Branch04=geodesics_4.ptsGeodesics,
    Branch05=geodesics_6.ptsGeodesics,
    Branch06=geodesics_7.ptsGeodesics,
    Branch07=geodesics_2.ptsGeodesics,
    FlattenInputs=True)

# ----
# Generate Curves and trim
pt_10 = Point(entwine)
expanded_bounding_box_bounding_box_3 = Box(expanded_bounding_box_bounding_box)
intcrv = Interpolate(Vertices=pt_10, Degree=3, Periodic=False, KnotStyle=1)  # -> Curve, Length, Domain
trim_2 = TrimWithBrep(Curve=intcrv.Curve, Brep=expanded_bounding_box_bounding_box_3)  # -> Inside, Outside
data = Data(trim_2.Inside)
rotation_angles_2 = Number(rotation_angles)
centre_point_2 = Point(centre_point)
yz = YZPlane(Origin=centre_point_2)
rotate_9 = Rotate(Geometry=flatten(data), Angle=graft(rotation_angles_2), Plane=centre_point_2)  # -> simplify(Geometry), Transform
mirror = Mirror(Geometry=rotate_9.Geometry, Plane=yz)  # -> Geometry, Transform
merge_2 = Merge(Data1=rotate_9.Geometry, Data2=mirror.Geometry)
geodesic_centreline_curves = Curve(merge_2)

# ----
# Get Intersection Points
srf_3 = Surface(srf_2)
geodesic_centreline_curves_2 = Curve(geodesic_centreline_curves)
split = SplitTree(Data=geodesic_centreline_curves_2, Masks=flatten("{0}"))  # -> Positive, flatten(Negative)
split_2 = SplitList(List=split.Positive, Index="8")  # -> ListA, ListB
merge_3 = Merge(Data1=split.Negative, Data2=split_2.ListB)  # -> flatten(Result)
divide_2 = DivideCurve(Curve=merge_3, Count=Slider(100, range=0..100), Kinks=False)  # -> simplify(Points), Tangents, Parameters
number_slider_5 = Slider(0.1, range=0..0.1)
srf_cp_10 = SurfaceClosestPoint(Point=divide_2.Points, Surface=srf_3)  # -> Point, UVPoint, Distance
data_2 = Data(split_2.ListA)
neg_3 = Negative(Value=number_slider_5)
evalsrf_2 = EvaluateSurface(Surface=srf_3, Point=srf_cp_10.UVPoint)  # -> Point, Normal, Frame
amp_9 = Amplitude(Vector=evalsrf_2.Normal, Amplitude=neg_3)
amp_10 = Amplitude(Vector=evalsrf_2.Normal, Amplitude=number_slider_5)
move_10 = Move(Geometry=divide_2.Points, Motion=amp_9)  # -> Geometry, Transform
move_11 = Move(Geometry=divide_2.Points, Motion=amp_10)  # -> Geometry, Transform
ccx = CurveCurve(CurveA=graft(data_2), CurveB=merge_3)  # -> simplify(Points), ParamsA, ParamsB
intcrv_2 = Interpolate(Vertices=move_11.Geometry, Degree=3, Periodic=False, KnotStyle=1)  # -> simplify(Curve), Length, Domain
intcrv_3 = Interpolate(Vertices=move_10.Geometry, Degree=3, Periodic=False, KnotStyle=1)  # -> simplify(Curve), Length, Domain
loft = Loft(
    Curves=[intcrv_2.Curve, intcrv_3.Curve],
    Options={Adjust=False, Closed=False, LoftEnds=0, LoftSimp=0, LoftType=0, Rebuild=10, Refit=0.01})
bcx = BrepCurve(Brep=flatten(loft), Curve=graft(data_2))  # -> Curves, simplify(Points)
c_script = CSharpScript(x=bcx.Points)  # -> out, A
# ---------- c_script: C# ----------
    A = x;
# ---------- end c_script ----------
c_script_2 = CSharpScript(x=ccx.Points)  # -> out, A; same code as c_script
c_script_3 = CSharpScript(x=c_script_2.A, y=c_script.A)  # -> out, A
# ---------- c_script_3: C# ----------
if(x == null)
      A = y;
    else
      A = x;
# ---------- end c_script_3 ----------
null = NullItem(Item=c_script_3.A)  # -> NullFlags, InvalidFlags, Description
cull = CullPattern(List=c_script_3.A, CullPattern=invert(null.NullFlags))  # -> simplify(List)
intersection_points = Point(cull)
preview = CustomPreview(
    Geometry=intersection_points,
    Shader={ambient=RGB(0, 0, 0), diffuse=RGB(255, 105, 180), emission=RGB(76, 32, 54), shine=0.5, specular=RGB(255, 255, 255), transparency=0})

# ---- group: End Angles
# End Angles Strips
_8_geodesic_curves = Curve(reparameterize(data_2))
srf_4 = Surface(srf_2)
number_slider_6 = Slider(0, range=0..100)
number_slider_7 = Slider(0, range=0..100)
lng = ListLength(List=_8_geodesic_curves)
lng_2 = ListLength(List=_8_geodesic_curves)
eval_4 = EvaluateCurve(Curve=graft(_8_geodesic_curves), Parameter="1")  # -> Point, Tangent, Angle
eval_5 = EvaluateCurve(Curve=graft(_8_geodesic_curves), Parameter="0")  # -> Point, Tangent, Angle
series_2 = Series(Start=number_slider_7, Step=number_slider_7, Count=lng_2)  # -> graft(Series)
series_3 = Series(Start=number_slider_6, Step=number_slider_6, Count=lng)  # -> graft(Series)
pdecon = Deconstruct(Point=eval_5.Point)  # -> XComponent, YComponent, ZComponent
pdecon_2 = Deconstruct(Point=eval_4.Point)  # -> XComponent, YComponent, ZComponent
smaller = SmallerThan(FirstNumber=pdecon.ZComponent, SecondNumber=Slider(0.001, range=0..0.001))  # -> SmallerThan, OrEqualTo
smaller_2 = SmallerThan(FirstNumber=pdecon_2.ZComponent, SecondNumber=Slider(0.001, range=0..0.001))  # -> SmallerThan, OrEqualTo
cull_2 = CullPattern(List=series_3, CullPattern=invert(smaller_2.SmallerThan))  # -> simplify(List)
cull_3 = CullPattern(List=eval_4.Point, CullPattern=smaller_2.SmallerThan)
cull_4 = CullPattern(List=series_2, CullPattern=invert(smaller.SmallerThan))  # -> simplify(List)
cull_5 = CullPattern(List=eval_5.Point, CullPattern=smaller.SmallerThan)
cull_6 = CullPattern(List=eval_4.Tangent, CullPattern=smaller_2.SmallerThan)
cull_7 = CullPattern(List=eval_5.Tangent, CullPattern=smaller.SmallerThan)
pt_11 = Point(cull_3)
srf_cp_11 = SurfaceClosestPoint(Point=pt_11, Surface=srf_4)  # -> Point, UVPoint, Distance
pt_12 = Point(cull_5)
srf_cp_12 = SurfaceClosestPoint(Point=pt_12, Surface=srf_4)  # -> Point, UVPoint, Distance
xy = XYPlane(Origin=Point(0, 0, 0))
evalsrf_3 = EvaluateSurface(Surface=srf_4, Point=srf_cp_11.UVPoint)  # -> Point, Normal, Frame
xy_2 = XYPlane(Origin=Point(0, 0, 0))
evalsrf_4 = EvaluateSurface(Surface=srf_4, Point=srf_cp_12.UVPoint)  # -> Point, Normal, Frame
ppx = PlanePlane(PlaneA=evalsrf_3.Frame, PlaneB=xy)
ppx_2 = PlanePlane(PlaneA=evalsrf_4.Frame, PlaneB=xy_2)
vec_2 = Vector(ppx)
vec_3 = Vector(cull_6)
vec_4 = Vector(cull_7)
vec_5 = Vector(ppx_2)
number_slider_8 = Slider(0.3, range=0..1)
number_slider_9 = Slider(0.3, range=0..1)
angle = Angle(VectorA=vec_3, VectorB=vec_2, Plane=evalsrf_3.Frame)  # -> simplify(Angle), Reflex
angle_2 = Angle(VectorA=vec_4, VectorB=vec_5, Plane=evalsrf_4.Frame)  # -> simplify(Angle), Reflex
amp_11 = Amplitude(Vector=vec_3, Amplitude=number_slider_8)
amp_12 = Amplitude(Vector=vec_2, Amplitude=number_slider_8)
amp_13 = Amplitude(Vector=vec_4, Amplitude=number_slider_9)
amp_14 = Amplitude(Vector=vec_5, Amplitude=number_slider_9)
pi_2 = Pi(Factor=Slider(0.5, range=0..1))
vdis_2 = VectorDisplay(Anchor=pt_11, Vector=amp_11)
vdis_3 = VectorDisplay(Anchor=pt_11, Vector=amp_12)
vdis_4 = VectorDisplay(Anchor=pt_12, Vector=amp_13)
subtraction_2 = Subtraction(A=angle.Angle, B=pi_2)
pi_3 = Pi(Factor=Slider(1.5, range=0..10))
vdis_5 = VectorDisplay(Anchor=pt_12, Vector=amp_14)
subtraction_3 = Subtraction(A=angle_2.Angle, B=pi_3)
merge_4 = Merge(Data1=cull_2, Data2=subtraction_2)  # -> flatten(Result)
merge_5 = Merge(Data1=cull_4, Data2=subtraction_3)  # -> flatten(Result)
startangle = Number(merge_4)
endangle = Number(merge_5)

# ----
# Curvature Controll
crv_5 = Curve(simplify(graft(data_2)))
divide_3 = DivideCurve(Curve=crv_5, Count=Slider(100, range=0..100), Kinks=False)  # -> Points, Tangents, Parameters
curvature = Curvature(Curve=crv_5, Parameter=divide_3.Parameters)  # -> P, K, C
circle = Circle(curvature.C)
c_script_4 = CSharpScript(x=circle)  # -> out, A
# ---------- c_script_4: C# ----------
    A = x.Radius;
# ---------- end c_script_4 ----------
sort_2 = SortList(Keys=c_script_4.A, ValuesA=circle)  # -> Keys, ValuesA
gradient = Gradient(
    LowerLimit=Slider(0.5, range=0..1),
    UpperLimit=Slider(3, range=0..10),
    Parameter=c_script_4.A,
    stops=[0: RGB(255, 0, 0), 0.5: RGB(255, 255, 0), 1: RGB(0, 128, 0)])
item_12 = ListItem(List=sort_2.Keys, Index=0, Wrap=True)
panel = Panel(item_12)
preview_2 = CustomPreview(Geometry=curvature.P, Shader=gradient)

# ---- group: StraightnessCheck
# Unroll And Straightness Controll
number_slider_10 = Slider(100, range=0..100)
crv_6 = Curve(data_2)
srf_5 = Surface(srf_2)
divide_4 = DivideCurve(Curve=crv_6, Count=number_slider_10, Kinks=False)  # -> Points, Tangents, Parameters
srf_cp_13 = SurfaceClosestPoint(Point=divide_4.Points, Surface=srf_5)  # -> Point, UVPoint, Distance
evalsrf_5 = EvaluateSurface(Surface=srf_5, Point=srf_cp_13.UVPoint)  # -> Point, Normal, Frame
xprod_2 = CrossProduct(VectorA=divide_4.Tangents, VectorB=evalsrf_5.Normal, Unitize=False)  # -> Vector, Length
amp_15 = Amplitude(Vector=xprod_2.Vector, Amplitude=Slider(0.025, range=0..0.1))
neg_4 = Negative(Value=amp_15)
move_12 = Move(Geometry=divide_4.Points, Motion=amp_15)  # -> Geometry, Transform
move_13 = Move(Geometry=divide_4.Points, Motion=neg_4)  # -> Geometry, Transform
ln = Line(StartPoint=move_12.Geometry, EndPoint=move_13.Geometry)
loft_2 = Loft(Curves=ln, Options={Adjust=False, Closed=False, LoftEnds=0, LoftSimp=0, LoftType=0, Rebuild=10, Refit=0.01})
unroll = UnrollBrep(Brep=loft_2, JoinUnrolled=False)  # -> flatten(UnrolledBrep)
lng_3 = ListLength(List=unroll)
series_4 = Series(Start=0, Step=Slider(0.21, range=0..1), Count=lng_3)
X = UnitX(Factor=series_4)
move_14 = Move(Geometry=unroll, Motion=X)  # -> Geometry, Transform
edges = BrepEdges(Brep=move_14.Geometry)  # -> Naked, Interior, NonManifold
len = Length(Curve=edges.Naked)
sort_3 = SortList(Keys=len, ValuesA=edges.Naked)  # -> Keys, reverse(ValuesA)
item_13 = ListItem(List=sort_3.ValuesA, Index=0, Wrap=True)
end_2 = EndPoints(Curve=item_13)  # -> Start, End
ln_2 = Line(StartPoint=end_2.Start, EndPoint=end_2.End)
divide_5 = DivideCurve(Curve=ln_2, Count=Slider(100, range=0..100), Kinks=False)  # -> Points, Tangents, Parameters
crv_cp_2 = CurveClosestPoint(Point=divide_5.Points, Curve=item_13)  # -> Point, Parameter, Distance
sort_4 = SortList(Keys=crv_cp_2.Distance, ValuesA=crv_cp_2.Point)  # -> reverse(Keys), reverse(ValuesA)
item_14 = ListItem(List=sort_4.ValuesA, Index=0, Wrap=True)
item_15 = ListItem(List=sort_4.Keys, Index=0, Wrap=True)
multiplication_2 = Multiplication(A=item_15, B=1000)
panel_2 = Panel(multiplication_2)
int = Integer(multiplication_2)

# ----
# Angle Bracket placements and angles
endangle_2 = Number(simplify(graft(endangle)))
width_angle_2 = Number(width_angle)
thickness_angle_2 = Number(thickness_angle)
thickness_plywood_2 = Number(thickness_plywood)
length_angle_2 = Number(length_angle)
srf_6 = Surface(srf_2)
height_hole_angle_2 = Number(height_hole_angle)
crv_7 = Curve(simplify(graft(data_2)))
tan = Tangent(Value=endangle_2)
division_2 = Division(A=thickness_plywood_2, B=2)
multiplication_3 = Multiplication(A=height_hole_angle_2, B=tan)
eval_6 = EvaluateCurve(Curve=crv_7, Parameter="0")  # -> Point, Tangent, Angle
vdis_6 = VectorDisplay(Anchor=eval_6.Point, Vector=eval_6.Tangent)
Z_2 = UnitZ(Factor=1)
srf_cp_14 = SurfaceClosestPoint(Point=eval_6.Point, Surface=srf_6)  # -> Point, UVPoint, Distance
Z_3 = UnitZ(Factor=1)
evalsrf_6 = EvaluateSurface(Surface=srf_6, Point=srf_cp_14.UVPoint)  # -> Point, Normal, Frame
startangle_2 = Number(simplify(graft(startangle)))
pl = ConstructPlane(Origin=eval_6.Point, XAxis=evalsrf_6.Normal, YAxis=Z_3)
eval_7 = EvaluateCurve(Curve=reparameterize(crv_7), Parameter="1")  # -> Point, Tangent, Angle
angle_3 = Angle(VectorA=Z_2, VectorB=eval_6.Tangent, Plane=pl)  # -> Angle, Reflex
xy_3 = XYPlane(Origin=eval_6.Point)
neg_5 = Negative(Value=eval_7.Tangent)
tan_2 = Tangent(Value=startangle_2)
Z_4 = UnitZ(Factor=1)
Z_5 = UnitZ(Factor=1)
devec = DeconstructVector(Vector=evalsrf_6.Normal)  # -> XComponent, YComponent, ZComponent
multiplication_4 = Multiplication(A=height_hole_angle_2, B=tan_2)
ppx_3 = PlanePlane(PlaneA=evalsrf_6.Frame, PlaneB=xy_3)
srf_cp_15 = SurfaceClosestPoint(Point=eval_7.Point, Surface=srf_6)  # -> Point, UVPoint, Distance
vec_6 = VectorXYZ(XComponent=devec.XComponent, YComponent=devec.YComponent, ZComponent=0)  # -> Vector, Length
num_2 = Number(angle_3.Angle)
xy_4 = XYPlane(Origin=eval_7.Point)
evalsrf_7 = EvaluateSurface(Surface=srf_6, Point=srf_cp_15.UVPoint)  # -> Point, Normal, Frame
pl_2 = ConstructPlane(Origin=eval_7.Point, XAxis=evalsrf_7.Normal, YAxis=Z_4)
angle_4 = Angle(VectorA=Z_5, VectorB=neg_5, Plane=pl_2)  # -> Angle, Reflex
pi_4 = Pi(Factor=Slider(1.5, range=0..10))
devec_2 = DeconstructVector(Vector=evalsrf_7.Normal)  # -> XComponent, YComponent, ZComponent
vec_7 = Vector(ppx_3)
vdis_7 = VectorDisplay(Anchor=eval_7.Point, Vector=neg_5)
ppx_4 = PlanePlane(PlaneA=evalsrf_7.Frame, PlaneB=xy_4)
panel_3 = Panel(angle_4.Angle)
vec_8 = VectorXYZ(XComponent=devec_2.XComponent, YComponent=devec_2.YComponent, ZComponent=0)  # -> Vector, Length
amp_16 = Amplitude(Vector=vec_7, Amplitude=multiplication_3)
subtraction_4 = Subtraction(A=pi_4, B=num_2)
addition_3 = Addition(A=division_2, B=thickness_angle_2)
strip_tangent = Vector(eval_6.Tangent)
surface_normal = Vector(evalsrf_6.Normal)
addition_4 = Addition(A=division_2, B=thickness_angle_2)
vec_9 = Vector(ppx_4)
vdis_8 = VectorDisplay(Anchor=eval_6.Point, Vector=amp_16)
vec_10 = Vector(vec_8.Vector)
vec_11 = Vector(vec_6.Vector)
neg_6 = Negative(Value=addition_3)
neg_7 = Negative(Value=addition_4)
amp_17 = Amplitude(Vector=vec_9, Amplitude=multiplication_4)
number_slider_11 = Slider(0.5, range=0..1)
amp_18 = Amplitude(Vector=vec_11, Amplitude=neg_6)
amp_19 = Amplitude(Vector=vec_10, Amplitude=neg_7)
vdis_9 = VectorDisplay(Anchor=eval_7.Point, Vector=amp_17)
addition_5 = Addition(A=amp_16, B=amp_18)
pi_5 = Pi(Factor=Slider(1.5, range=0..10))
num_3 = Number(angle_4.Angle)
move_15 = Move(Motion=Vector(0, 0, 10))  # -> Geometry, Transform
addition_6 = Addition(A=amp_17, B=amp_19)
division_3 = Division(A=width_angle_2, B=2)
move_16 = Move(Motion=Vector(0, 0, 10))  # -> Geometry, Transform
division_4 = Division(A=width_angle_2, B=2)
move_17 = Move(Geometry=eval_6.Point, Motion=addition_5)  # -> Geometry, Transform
neg_8 = Negative(Value=division_3)
subtraction_5 = Subtraction(A=pi_5, B=num_3)
move_18 = Move(Geometry=eval_7.Point, Motion=addition_6)  # -> Geometry, Transform
neg_9 = Negative(Value=division_4)
dom_3 = ConstructDomain(DomainStart=neg_8, DomainEnd=division_3)
pl_3 = ConstructPlane(Origin=move_17.Geometry, XAxis=vec_7, YAxis=vec_11)
dom_4 = ConstructDomain(DomainStart=neg_9, DomainEnd=division_4)
pl_4 = ConstructPlane(Origin=move_18.Geometry, XAxis=vec_9, YAxis=vec_10)
rectangle = Rectangle(Plane=pl_3, XSize=dom_3, YSize=length_angle_2, Radius=0)  # -> Rectangle, Length
rectangle_2 = Rectangle(Plane=pl_4, XSize=dom_4, YSize=length_angle_2, Radius=0)  # -> Rectangle, Length
rot3d = Rotate3D(Geometry=rectangle.Rectangle, Angle=subtraction_4, Center=move_17.Geometry, Axis=vec_7)  # -> Geometry, Transform
number_slider_12 = Slider(1, range=0..1)
rot3d_2 = Rotate3D(Geometry=rectangle_2.Rectangle, Angle=subtraction_5, Center=move_18.Geometry, Axis=vec_9)  # -> Geometry, Transform
centre_point_3 = Point(centre_point)
pln = Plane(rot3d.Geometry)
boxrec = BoxRectangle(Rectangle=[rectangle.Rectangle, rot3d.Geometry], Height=thickness_angle_2)
number_slider_13 = Slider(0.1, range=0..1)
deplane = DeconstructPlane(Plane=pln)  # -> Origin, XAxis, YAxis, ZAxis
pln_2 = Plane(rot3d_2.Geometry)
number_slider_14 = Slider(0.1, range=0..1)
deplane_2 = DeconstructPlane(Plane=pln_2)  # -> Origin, XAxis, YAxis, ZAxis
vec_12 = VectorXYZ(XComponent=number_slider_12, YComponent=number_slider_12, ZComponent=0)  # -> Vector, Length
xy_5 = XYPlane(Origin=centre_point_3)
neg_10 = Negative(Value=number_slider_13)
amp_20 = Amplitude(Vector=deplane.YAxis, Amplitude=height_hole_angle_2)
neg_11 = Negative(Value=number_slider_14)
amp_21 = Amplitude(Vector=deplane_2.YAxis, Amplitude=height_hole_angle_2)
pl_5 = PlaneNormal(Origin=centre_point_3, ZAxis=vec_12.Vector)
move_19 = Move(Geometry=deplane.Origin, Motion=amp_20)  # -> Geometry, Transform
move_20 = Move(Geometry=deplane_2.Origin, Motion=amp_21)  # -> Geometry, Transform
pdecon_3 = Deconstruct(Point=move_20.Geometry)  # -> XComponent, YComponent, ZComponent
line = LineSDL(Start=move_19.Geometry, Direction=deplane.ZAxis, Length=[neg_10, number_slider_13])
boxrec_2 = BoxRectangle(Rectangle=[rectangle_2.Rectangle, rot3d_2.Geometry], Height=thickness_angle_2)
pdecon_4 = Deconstruct(Point=move_19.Geometry)  # -> XComponent, YComponent, ZComponent
line_2 = LineSDL(Start=move_20.Geometry, Direction=deplane_2.ZAxis, Length=[neg_11, number_slider_14])
panel_4 = Panel(pdecon_4.ZComponent)
angle_hole_height_tilted = Number(pdecon_4.ZComponent)
smaller_3 = SmallerThan(FirstNumber=pdecon_3.ZComponent, SecondNumber=height_hole_angle_2)  # -> SmallerThan, OrEqualTo
cull_8 = CullPattern(List=rectangle_2.Rectangle, CullPattern=smaller_3.SmallerThan)
cull_9 = CullPattern(List=boxrec_2, CullPattern=smaller_3.SmallerThan)
int_2 = Integer(smaller_3.SmallerThan)
multiplication_5 = Multiplication(A=pdecon_3.ZComponent, B=int_2)
panel_5 = Panel(multiplication_5)
angle_hole_height_tilted_2 = Number(multiplication_5)
merge_6 = Merge(Data1=boxrec, Data2=cull_9)
deg = Degrees(Radians=angle_3.Angle)
mirror_2 = Mirror(Geometry=merge_6, Plane=pl_5)  # -> Geometry, Transform
subtraction_6 = Subtraction(A=Slider(360, range=0..1000), B=deg)  # -> flatten(Result)
merge_7 = Merge(Data1=mirror_2.Geometry, Data2=merge_6)
rotation_angles_3 = Number(rotation_angles)
mirror_3 = Mirror(Geometry=cull_8, Plane=pl_5)  # -> Geometry, Transform
mirror_4 = Mirror(Geometry=rectangle.Rectangle, Plane=pl_5)  # -> Geometry, Transform
merge_8 = Merge(Data1=mirror_3.Geometry, Data2=cull_8)
merge_9 = Merge(Data1=mirror_4.Geometry, Data2=rectangle.Rectangle)
rotate_10 = Rotate(Geometry=graft(merge_7), Angle=rotation_angles_3, Plane=xy_5)  # -> Geometry, Transform
preview_3 = CustomPreview(Geometry=rotate_10.Geometry, Shader=ColourSwatch(SwatchColor=RGB(130, 130, 130)))
rotate_11 = Rotate(Geometry=graft(merge_8), Angle=rotation_angles_3, Plane=xy_5)  # -> Geometry, Transform
rotate_12 = Rotate(Geometry=graft(merge_9), Angle=rotation_angles_3, Plane=xy_5)  # -> Geometry, Transform

# ---- group: Boundary Curves
boundary_elongation_2 = Number(boundary_elongation)
crv_8 = Curve(reparameterize(crv_2))
width_boundary_2 = Number(width_boundary)
centre_point_4 = Point(centre_point)
thickness_boundary_2 = Number(thickness_boundary)
ext = ExtendCurve(Curve=crv_8, Type=2, Start=boundary_elongation_2, End=boundary_elongation_2)
division_5 = Division(A=width_boundary_2, B=2)
xy_6 = XYPlane(Origin=centre_point_4)
neg_12 = Negative(Value=division_5)
number_slider_15 = Slider(15, range=0..100)
offset = Offset(Curve=ext, Distance=neg_12, Plane=xy_6, Corners=1)
offset_2 = Offset(Curve=ext, Distance=division_5, Plane=xy_6, Corners=1)
Z_6 = UnitZ(Factor=thickness_boundary_2)
neg_13 = Negative(Value=number_slider_15)
neg_14 = Negative(Value=Z_6)
loft_3 = Loft(
    Curves=[offset_2, offset],
    Options={Adjust=False, Closed=False, LoftEnds=0, LoftSimp=0, LoftType=0, Rebuild=10, Refit=0.01})
series_5 = Series(Start=neg_13, Step=1, Count=number_slider_15)
series_6 = Series(Start=Slider(11, range=0..100), Step=1, Count=number_slider_15)
edges_2 = BrepEdges(Brep=loft_3)  # -> Naked, Interior, NonManifold
pt_13 = ConstructPoint(XCoordinate=series_6, YCoordinate=graft(series_5), ZCoordinate=0)  # -> flatten(Point)
extr = Extrude(Base=loft_3, Direction=neg_14)
join = JoinCurves(Curves=edges_2.Naked, Preserve=False)
incurve = PointInCurve(Point=pt_13, Curve=join)  # -> Relationship, Point
rotation_angles_4 = Number(rotation_angles)
rotate_13 = Rotate(Geometry=extr, Angle=rotation_angles_4, Plane=xy_6)  # -> Geometry, Transform
equals = Equality(FirstNumber=incurve.Relationship, SecondNumber=Slider(2, range=0..10))  # -> Equality, Inequality
cull_10 = CullPattern(List=pt_13, CullPattern=equals.Equality)
thickness_angle_3 = Number(thickness_angle)
division_6 = Division(A=Slider(0.06, range=0..0.1), B=2)
neg_15 = Negative(Value=thickness_angle_3)
cyl = Cylinder(Base=cull_10, Radius=division_6, Length=Slider(0.03, range=0..0.1))
Z_7 = UnitZ(Factor=neg_15)
cap = CapHoles(Brep=cyl)
move_21 = Move(Geometry=rotate_13.Geometry, Motion=Z_7)  # -> Geometry, Transform
rotate_14 = Rotate(Geometry=graft(cap), Angle=rotation_angles_4, Plane=xy_6)  # -> Geometry, Transform

# ----
# Prouction drawings
# Strip Fabrication Drawings
# Angle Brackets Bending Angles
swatch = ColourSwatch(SwatchColor=RGB(255, 255, 255))
preview_4 = CustomPreview(Geometry=move_14.Geometry, Shader=swatch)
deg_2 = Degrees(Radians=angle_4.Angle)
subtraction_7 = Subtraction(A=Slider(360, range=0..1000), B=deg_2)  # -> flatten(Result)
panel_6 = Panel(subtraction_7)
start_plates = Rectangle(rotate_11.Geometry)
panel_7 = Panel("""1S
2S
3S
4S
5S
6S
7S
8S""")
base_planes_angles = Rectangle(simplify(start_plates))
number_slider_16 = Slider(5, range=0..10)
bool = Boolean(flatten(smaller_3.SmallerThan))
cull_11 = CullPattern(List=panel_7, CullPattern=bool)
cull_12 = CullPattern(List=panel_6, CullPattern=bool)
pln_3 = Plane(base_planes_angles)
division_7 = Division(A=subtraction_6, B=number_slider_16)
division_8 = Division(A=cull_12, B=number_slider_16)
pt_14 = Point(pln_3)
round = Round(Number=cull_12)  # -> Nearest, Floor, Ceiling
round_2 = Round(Number=subtraction_6)  # -> Nearest, Floor, Ceiling
round_3 = Round(Number=division_7)  # -> Nearest, Floor, Ceiling
round_4 = Round(Number=division_8)  # -> Nearest, Floor, Ceiling
multiplication_6 = Multiplication(A=round_3.Nearest, B=number_slider_16)
multiplication_7 = Multiplication(A=round_4.Nearest, B=number_slider_16)
panel_8 = Panel(cull_12)
panel_9 = Panel(subtraction_6)
panel_10 = Panel(round.Nearest)
panel_11 = Panel(round_2.Nearest)
panel_12 = Panel(multiplication_7)
number_slider_17 = Slider(0.05, range=0..0.1)
panel_13 = Panel("""1E
2E
3E
4E
5E
6E
7E
8E""")
panel_14 = Panel(cull_11)
number_slider_18 = Slider(0.1, range=0..0.1)
number_slider_19 = Slider(0.13, range=0.05..1)
bolt_hole_radius_2 = Number(bolt_hole_radius)
X_2 = UnitX(Factor=1)
Y = UnitY(Factor=1)
neg_16 = Negative(Value=X_2)
swatch_2 = ColourSwatch(SwatchColor=RGB(255, 255, 255))

# ---- group: StraightnessCheck (continued)
tag = TextTag3D(Location=item_14, Text=int, Size=Slider(0.1, range=0..1), Colour=swatch, Justification=7)

# ----
# Intersection Points
number_slider_20 = Slider(3, range=0..10)
_8_geodisic_curves = Curve(simplify(graft(data_2)))
intersection_points_2 = Point(intersection_points)
lng_4 = ListLength(List=flatten(_8_geodisic_curves))
series_7 = Series(Start=number_slider_20, Step=Slider(0.8, range=0..1), Count=lng_4)
pt_15 = ConstructPoint(XCoordinate=graft(series_7), YCoordinate=0, ZCoordinate=0)  # -> simplify(Point)
trim_3 = TrimTree(Tree=intersection_points_2, Depth=1)
crv_cp_3 = CurveClosestPoint(Point=trim_3, Curve=_8_geodisic_curves)  # -> Point, Parameter, Distance
number_slider_21 = Slider(0, range=0..100)
base_full_fabrication_x_value = Number(series_7)
base_full_fabrication_points = Point(pt_15)
shatter_2 = Shatter(Curve=_8_geodisic_curves, Parameters=crv_cp_3.Parameter)  # -> simplify(Segments)
len_2 = Length(Curve=shatter_2)
ins = InsertItems(List=len_2, Item=number_slider_21, Indices=number_slider_21, Wrap=True)  # -> reverse(List)
c_script_5 = CSharpScript(x=ins)  # -> out, A; inputs x: list of Double
# ---------- c_script_5: C# ----------
    List<double> sum = new List<double>();

    for (int i = 0; i < x.Count; i++)
    {
      double d = 0;
      for (int j = 0; j < i; j++)
      {
        d += x[j];
      }

      sum.Add(d);
    }

    A = sum;
# ---------- end c_script_5 ----------
Y_2 = UnitY(Factor=c_script_5.A)
intersection_position_along_length = Number(c_script_5.A)
move_22 = Move(Geometry=base_full_fabrication_points, Motion=Y_2)  # -> Geometry, Transform
intersection_points_3 = Point(move_22.Geometry)
width_strips_2 = Number(width_strips)
pdecon_5 = Deconstruct(Point=intersection_points_3)  # -> XComponent, YComponent, ZComponent
subtraction_8 = Subtraction(A=pdecon_5.XComponent, B=width_strips_2)
pt_16 = ConstructPoint(XCoordinate=subtraction_8, YCoordinate=pdecon_5.YComponent, ZCoordinate=0)
tag_2 = TextTag3D(Location=pt_16, Text=pdecon_5.YComponent, Size=Slider(0.03, range=0..0.1), Colour=swatch, Justification=6)

# ----
# Strip Segementing
intersection_position_along_length_2 = Number(intersection_position_along_length)
max_length_plywood_2 = Number(max_length_plywood)
strip_overlap_2 = Number(strip_overlap)
c_script_6 = CSharpScript(
    x=intersection_position_along_length_2,
    length=max_length_plywood_2,
    tol=Slider(0.3, range=0.15..0.4),
    overlap=strip_overlap_2)  # -> out, simplify(A); inputs x: list of Double, length: Double, tol: Double, overlap: Double
# ---------- c_script_6: C# ----------
    List<Interval> segments = new List<Interval>();


    double startValue = 0;

    bool flag = true;
    for (int i = 0; i < x.Count; i++)
    {
      double tempTol = i == x.Count - 1 ? 0 : tol;
      if(x[i] + tempTol - startValue < length /* && x[i] - x[i + 1] < 2 * tol*/)
      {
        flag = true;
      }
      else
      {
        double avg = 0;

        string metod;

        if(x[i] - x[i - 1] < 2 * tol)
        {
          avg = (x[i] + x[i - 1]) / 2 + overlap / 2;
          //Print("Hey" + i);
          metod = "met 1 ";
        }
        else
        {
          metod = "met 2 ";
          avg = x[i] - tol;
        }
        Print(metod + (i).ToString() + ": " + (x[i] - x[i - 1]).ToString() + " " + x[i] + " " + x[i - 1]);
        double endValue = Math.Min(startValue + length, avg);
        Interval val = new Interval(startValue, endValue);
        segments.Add(val);
        startValue = endValue - overlap;
        flag = true;
      }
    }

    if(flag)
    {
      Interval val = new Interval(startValue, x[x.Count - 1]);
      segments.Add(val);
    }


    A = segments;
# ---------- end c_script_6 ----------
dedomain = DeconstructDomain(Domain=c_script_6.A)  # -> Start, End
start_value_strip_segements = Number(dedomain.Start)
end_value_strip_segements = Number(dedomain.End)
addition_7 = Addition(A=start_value_strip_segements, B=end_value_strip_segements)
base_full_fabrication_x_value_2 = Number(series_7)
division_9 = Division(A=addition_7, B=2)
pt_17 = ConstructPoint(XCoordinate=graft(base_full_fabrication_x_value_2), YCoordinate=division_9, ZCoordinate=0)  # -> simplify(Point)
panel_15 = Panel("""A
B
C
D
E
F
G
H
I
J
K
L
M
N
O
P
Q
R
T
S
U
V
X""")
c_script_7 = CSharpScript(x=pt_17, y=panel_15)  # -> out, A; inputs x: tree, y: list of String
# ---------- c_script_7: C# ----------
    DataTree<string> naming = new DataTree<string>();

    for (int i = 0; i < x.BranchCount; i++)
    {
      GH_Path path = new GH_Path(i);

      for (int j = 0; j < x.Branch(i).Count; j++)
      {
        naming.Add(i + 1 + y[j], path);
      }
    }

    A = naming;
# ---------- end c_script_7 ----------
strip_segment_names = Text(c_script_7.A)
tag_3 = TextTag3D(Location=pt_17, Text=c_script_7.A, Size=Slider(0.03, range=0..0.1), Colour=swatch_2, Justification=5)

# ----
# Strip Segement Boundaries
start_value_strip_segements_2 = Number(start_value_strip_segements)
end_value_strip_segements_2 = Number(end_value_strip_segements)
base_full_fabrication_x_value_3 = Number(base_full_fabrication_x_value)
width_strips_3 = Number(width_strips)
pt_18 = ConstructPoint(XCoordinate=graft(base_full_fabrication_x_value_3), YCoordinate=start_value_strip_segements_2, ZCoordinate=0)  # -> simplify(Point)
pt_19 = ConstructPoint(XCoordinate=graft(base_full_fabrication_x_value_3), YCoordinate=end_value_strip_segements_2, ZCoordinate=0)  # -> simplify(Point)
number_slider_22 = Slider(0, range=0..100)
startangle_3 = Number(simplify(graft(startangle)))
endangle_3 = Number(simplify(graft(endangle)))
lng_5 = ListLength(List=pt_19)
division_10 = Division(A=width_strips_3, B="2")
subtraction_9 = Subtraction(A=lng_5, B=1)
number_slider_23 = Slider(0, range=0..100)
series_8 = Series(Start=number_slider_22, Step=number_slider_22, Count=subtraction_9)  # -> simplify(Series)
lng_6 = ListLength(List=pt_18)
subtraction_10 = Subtraction(A=lng_6, B=1)
merge_10 = Merge(Data1=series_8, Data2=endangle_3)
series_9 = Series(Start=number_slider_23, Step=number_slider_23, Count=subtraction_10)  # -> simplify(Series)
tan_3 = Tangent(Value=merge_10)
multiplication_8 = Multiplication(A=division_10, B=tan_3)
merge_11 = Merge(Data1=startangle_3, Data2=series_9)
vec_13 = VectorXYZ(XComponent=division_10, YComponent=multiplication_8, ZComponent=0)  # -> Vector, Length
tan_4 = Tangent(Value=merge_11)
neg_17 = Negative(Value=vec_13.Vector)
multiplication_9 = Multiplication(A=division_10, B=tan_4)
move_23 = Move(Geometry=pt_19, Motion=vec_13.Vector)  # -> Geometry, Transform
move_24 = Move(Geometry=pt_19, Motion=neg_17)  # -> Geometry, Transform
vec_14 = VectorXYZ(XComponent=division_10, YComponent=multiplication_9, ZComponent=0)  # -> Vector, Length
neg_18 = Negative(Value=vec_14.Vector)
move_25 = Move(Geometry=pt_18, Motion=vec_14.Vector)  # -> Geometry, Transform
move_26 = Move(Geometry=pt_18, Motion=neg_18)  # -> Geometry, Transform
ln_3 = Line(StartPoint=move_25.Geometry, EndPoint=move_26.Geometry)  # -> graft(Line)
ln_4 = Line(StartPoint=move_23.Geometry, EndPoint=move_24.Geometry)  # -> graft(Line)
loft_4 = Loft(Curves=[ln_3, ln_4], Options={Adjust=False, Closed=False, LoftEnds=0, LoftSimp=0, LoftType=0, Rebuild=10, Refit=0.01})
edges_3 = BrepEdges(Brep=loft_4)  # -> Naked, Interior, NonManifold
join_2 = JoinCurves(Curves=edges_3.Naked, Preserve=False)  # -> simplify(Curves)
trim_4 = TrimTree(Tree=join_2, Depth=1)

# ----
# Overlap Connection Points
end_value_strip_segements_3 = Number(end_value_strip_segements)
start_value_strip_segements_3 = Number(start_value_strip_segements)
shift = ShiftList(List=start_value_strip_segements_3, Shift=1, Wrap=False)
base_point = Point(base_full_fabrication_points)
short = ShortestList(ListA=end_value_strip_segements_3, ListB=shift, TrimMode=2)  # -> ListA, ListB
subtraction_11 = Subtraction(A=short.ListA, B=short.ListB)
division_11 = Division(A=subtraction_11, B=4)
pdecon_6 = Deconstruct(Point=base_point)  # -> XComponent, YComponent, ZComponent
addition_8 = Addition(A=short.ListB, B=division_11)
subtraction_12 = Subtraction(A=short.ListA, B=division_11)
pt_20 = ConstructPoint(XCoordinate=pdecon_6.XComponent, YCoordinate=addition_8, ZCoordinate=0)
pt_21 = ConstructPoint(XCoordinate=pdecon_6.XComponent, YCoordinate=subtraction_12, ZCoordinate=0)
merge_12 = Merge(Data1=pt_21, Data2=pt_20)
overlapconnectionpoints = Point(merge_12)

# ----
# End Connection Points
angle_hole_height_tilted_end = Number(angle_hole_height_tilted)
start_value_strip_segements_4 = Number(start_value_strip_segements)
end_value_strip_segements_4 = Number(end_value_strip_segements)
angle_hole_height_tilted_3 = Number(angle_hole_height_tilted_2)
height_hole_angle_3 = Number(height_hole_angle)
startangle_4 = Number(simplify(graft(startangle_3)))
endangle_4 = Number(simplify(graft(endangle_3)))
x_values = Number(base_full_fabrication_x_value_3)
cos = Cosine(Value=startangle_4)
item_16 = ListItem(List=start_value_strip_segements_4, Index=0, Wrap=True)
cos_2 = Cosine(Value=endangle_4)
item_17 = ListItem(List=end_value_strip_segements_4, Index=0, Wrap=True)  # -> Item1, Item
division_12 = Division(A=angle_hole_height_tilted_3, B=cos)
division_13 = Division(A=angle_hole_height_tilted_end, B=cos_2)
addition_9 = Addition(A=division_12, B=item_16)
subtraction_13 = Subtraction(A=item_17.Item1, B=division_13)
pt_22 = ConstructPoint(XCoordinate=graft(x_values), YCoordinate=addition_9, ZCoordinate=0)
pt_23 = ConstructPoint(XCoordinate=graft(x_values), YCoordinate=subtraction_13, ZCoordinate=0)
merge_13 = Merge(Data1=pt_22, Data2=pt_23)
angle_connection_points = Point(merge_13)

panel_16 = Panel(multiplication_6)

# ----
# Visualization and design checks
number_slider_24 = Slider(1, range=0..1)
pt_24 = Point(Point(18.5, -7.5, 0))
crv_9 = Curve(simplify(graft(data_2)))
centre_point_5 = Point(centre_point)
holeradius = Number(bolt_hole_radius)
angle_connection_points_2 = Point(angle_connection_points)
overlapconnectionpoints_2 = Point(overlapconnectionpoints)
intersectionpoints = Point(intersection_points_3)
flip_2 = FlipCurve(Curve=crv_9)  # -> reparameterize(Curve), Flag
srf_7 = Surface(srf_2)
domain = Domain(c_script_6.A)
vec_15 = VectorXYZ(XComponent=number_slider_24, YComponent=number_slider_24, ZComponent=0)  # -> Vector, Length
merge_14 = Merge(Data1=simplify(intersectionpoints), Data2=simplify(overlapconnectionpoints_2), Data3=simplify(angle_connection_points_2))
crv_10 = Curve(reparameterize(flip_2.Curve))
len_3 = Length(Curve=crv_10)
pl_6 = PlaneNormal(Origin=centre_point_5, ZAxis=vec_15.Vector)
pdecon_7 = Deconstruct(Point=merge_14)  # -> XComponent, YComponent, ZComponent
dedomain_2 = DeconstructDomain(Domain=domain)  # -> Start, End
number_slider_25 = Slider(0, range=0..100)
division_14 = Division(A=pdecon_7.YComponent, B=len_3)
division_15 = Division(A=dedomain_2.Start, B=len_3)
eval_8 = EvaluateLength(Curve=crv_10, Length=division_14, Normalized=True)  # -> Point, Tangent, Parameter
division_16 = Division(A=dedomain_2.End, B=len_3)
rotation_angles_5 = Number(rotation_angles)
c_script_8 = CSharpScript(x=eval_8.Point, y=eval_8.Parameter)  # -> out, A; inputs x: list, y: list of Double
# ---------- c_script_8: C# ----------
    var list = new List<object>();

    for (int i = 0; i < x.Count; i++)
    {
      if(y[i] != 0 && y[i] != 1)
        list.Add(x[i]);
    }

    A = list;
# ---------- end c_script_8 ----------
eval_9 = EvaluateLength(Curve=crv_10, Length=division_15, Normalized=True)  # -> Point, Tangent, Parameter
eval_10 = EvaluateLength(Curve=crv_10, Length=division_16, Normalized=True)  # -> Point, Tangent, Parameter
endangle_5 = Number(simplify(graft(endangle)))
srf_cp_16 = SurfaceClosestPoint(Point=c_script_8.A, Surface=srf_7)  # -> Point, UVPoint, Distance
startangle_5 = Number(simplify(graft(startangle)))
c_script_9 = CSharpScript(c=crv_10, t1=eval_9.Parameter, t2=eval_10.Parameter)  # -> out, A; inputs c: Curve, t1: Double, t2: Double
# ---------- c_script_9: C# ----------
    Curve[] arr = c.Split(new double[]{t1,t2});


    if(arr.Length > 2 || t1 > 0.001)
      A = arr[1];
    else
      A = arr[0];
# ---------- end c_script_9 ----------
c_script_10 = CSharpScript(x=c_script_9.A)  # -> out, A; inputs x: list
# ---------- c_script_10: C# ----------
    var posNeg = new List<double>();
    bool flag = true;
    
    for (int i = 0; i < x.Count; i++)
    {
      flag = !flag;
      
      if(flag)
        posNeg.Add(1);
      else
        posNeg.Add(-1);
    }
    
    A = posNeg;
# ---------- end c_script_10 ----------
lng_7 = ListLength(List=c_script_10.A)
subtraction_14 = Subtraction(A=lng_7, B=1)
series_10 = Series(Start=number_slider_25, Step=number_slider_25, Count=subtraction_14)  # -> simplify(Series)
thickness_plywood_3 = Number(thickness_plywood)
number_slider_26 = Slider(0.03, range=0..0.1)
division_17 = Division(A=number_slider_26, B=2)
evalsrf_8 = EvaluateSurface(Surface=srf_7, Point=srf_cp_16.UVPoint)  # -> Point, Normal, Frame
neg_19 = Negative(Value=division_17)
merge_15 = Merge(Data1=series_10, Data2=endangle_5)
merge_16 = Merge(Data1=startangle_5, Data2=series_10)
cluster = Cluster(
    srf=srf_7,
    crv=c_script_9.A,
    N=Slider(50, range=0..100),
    A=thickness_plywood_3,
    A_2=Slider(0.05, range=0..0.1),
    posneg=Slider(0, range=0..100),
    startangle=merge_16,
    endangle=merge_15)
amp_22 = Amplitude(Vector=evalsrf_8.Normal, Amplitude=neg_19)
move_27 = Move(Geometry=evalsrf_8.Frame, Motion=amp_22)  # -> Geometry, Transform
centre_point_6 = Point(centre_point)
brep = Brep(cluster)
cyl_2 = Cylinder(Base=move_27.Geometry, Radius=holeradius, Length=number_slider_26)
crv_11 = Curve(c_script_9.A)
memberid = Text(strip_segment_names)
cap_2 = CapHoles(Brep=cyl_2)
srf_8 = Surface(srf_7)
mirror_5 = Mirror(Geometry=flatten(cap_2), Plane=pl_6)  # -> Geometry, Transform
curvepoint = PointOnCurve(crv_11, parameter=0.354)
srf_cp_17 = SurfaceClosestPoint(Point=curvepoint, Surface=srf_8)  # -> Point, UVPoint, Distance
mirror_6 = Mirror(Geometry=brep, Plane=pl_6)  # -> Geometry, Transform
merge_17 = Merge(Data1=flatten(cap_2), Data2=mirror_5.Geometry)
evalsrf_9 = EvaluateSurface(Surface=srf_8, Point=srf_cp_17.UVPoint)  # -> Point, Normal, Frame
merge_18 = Merge(Data1=flatten(mirror_6.Geometry), Data2=brep)
deplane_3 = DeconstructPlane(Plane=evalsrf_9.Frame)  # -> Origin, XAxis, YAxis, ZAxis
rotate_15 = Rotate(Geometry=flatten(merge_17), Angle=graft(rotation_angles_5), Plane=centre_point_6)  # -> simplify(Geometry), Transform
rotate_16 = Rotate(Geometry=flatten(merge_18), Angle=graft(rotation_angles_5), Plane=centre_point_6)  # -> simplify(Geometry), Transform
swatch_3 = ColourSwatch(SwatchColor=RGB(0, 0, 0))
swatch_4 = ColourSwatch(SwatchColor=RGB(199, 158, 36))
pl_7 = ConstructPlane(Origin=deplane_3.Origin, XAxis=deplane_3.YAxis, YAxis=deplane_3.XAxis)
entwine_2 = Entwine(
    Branch00=ColourSwatch(SwatchColor=RGB(255, 0, 0)),
    Branch01=ColourSwatch(SwatchColor=RGB(255, 255, 0)),
    Branch02=ColourSwatch(SwatchColor=RGB(255, 0, 255)),
    Branch03=ColourSwatch(SwatchColor=RGB(0, 0, 255)),
    Branch04=ColourSwatch(SwatchColor=RGB(0, 255, 255)),
    Branch05=ColourSwatch(SwatchColor=RGB(0, 255, 0)),
    Branch06=ColourSwatch(SwatchColor=RGB(255, 140, 0)),
    Branch07=ColourSwatch(SwatchColor=RGB(0, 0, 0)),
    FlattenInputs=True)  # -> simplify(Result)
preview_5 = CustomPreview(Geometry=rotate_15.Geometry, Shader=swatch_3)
panel_17 = Panel(eval_9.Parameter)
preview_6 = CustomPreview(Geometry=rotate_16.Geometry, Shader=swatch_4)
preview_7 = CustomPreview(Geometry=crv_11, Shader=entwine_2)
tag_4 = TextTag3D(Location=pl_7, Text=memberid, Size=Slider(0.1, range=0..0.1), Colour=entwine_2, Justification=5)

# ---- group: Boundary Curves (continued)
col = Colour(swatch_3)
col_2 = Colour(swatch_4)
preview_8 = CustomPreview(Geometry=move_21.Geometry, Shader=col_2)
preview_9 = CustomPreview(Geometry=rotate_14.Geometry, Shader=col)

# ----
angle_connection_points_3 = Point(angle_connection_points)
crv_12 = Curve(reparameterize(flip_2.Curve))
pdecon_8 = Deconstruct(Point=angle_connection_points_3)  # -> XComponent, YComponent, ZComponent
len_4 = Length(Curve=crv_12)
angle_hole_height_tilted_4 = Number(angle_hole_height_tilted_2)
angle_hole_height_tilted_end_2 = Number(angle_hole_height_tilted)
division_18 = Division(A=pdecon_8.YComponent, B=len_4)
eval_11 = EvaluateLength(Curve=crv_12, Length=division_18, Normalized=True)  # -> Point, Tangent, Parameter
panel_18 = Panel(angle_hole_height_tilted_4)
pdecon_9 = Deconstruct(Point=eval_11.Point)  # -> XComponent, YComponent, ZComponent
merge_19 = Merge(Data1=angle_hole_height_tilted_4, Data2=angle_hole_height_tilted_end_2)
panel_19 = Panel(angle_hole_height_tilted_end_2)
subtraction_15 = Subtraction(A=simplify(pdecon_9.ZComponent), B=simplify(merge_19))
multiplication_10 = Multiplication(A=subtraction_15, B=1000)
panel_20 = Panel(multiplication_10)
panel_21 = Panel(pdecon_9.ZComponent)

mirror_7 = Mirror(Geometry=flatten(move_27.Geometry), Plane=pl_6)  # -> Geometry, Transform
merge_20 = Merge(Data1=flatten(move_27.Geometry), Data2=mirror_7.Geometry)
rotate_17 = Rotate(Geometry=flatten(merge_20), Angle=graft(rotation_angles_5), Plane=centre_point_6)  # -> simplify(Geometry), Transform
number_slider_27 = Slider(0.001, range=0..0.001)
pt_25 = Point(flatten(rotate_17.Geometry))
cullpt_2 = CullDuplicates(Points=pt_25, Tolerance=Slider(0.005, range=0..0.01), CullMode=3)  # -> Points, Indices, Valence
lng_8 = ListLength(List=cullpt_2.Points)
division_19 = Division(A=lng_8, B=Slider(8, range=0..10))

# ----
# Final Fabrication Drawings
stripboundaries = Curve(graft(trim_4))
overlapconnectionpoints_3 = Point(overlapconnectionpoints)
angle_connection_points_4 = Point(angle_connection_points)
intersectionpoints_2 = Point(intersection_points_3)
merge_21 = Merge(Data1=intersectionpoints_2, Data2=overlapconnectionpoints_3, Data3=angle_connection_points_4)  # -> flatten(Result)
bbox_2 = BoundingBox(Content=stripboundaries, Plane=PlaneXY(0, 0, 0))  # -> Box, Box_2
c_script_11 = CSharpScript(x=bbox_2.Box)  # -> out, X, Y; inputs x: Box
# ---------- c_script_11: C# ----------
    X = x.X;
    Y = x.Y;
# ---------- end c_script_11 ----------
incurve_2 = PointInCurve(Point=merge_21, Curve=stripboundaries)  # -> Relationship, Point
dedomain_3 = DeconstructDomain(Domain=c_script_11.Y)  # -> Start, End
dedomain_4 = DeconstructDomain(Domain=c_script_11.X)  # -> Start, End
subtraction_16 = Subtraction(A=dedomain_3.End, B=dedomain_3.Start)  # -> simplify(Result)
addition_10 = Addition(A=dedomain_4.Start, B=dedomain_4.End)
equals_2 = Equality(FirstNumber=incurve_2.Relationship, SecondNumber=Slider(2, range=0..10))  # -> Equality, Inequality
cull_13 = CullPattern(List=merge_21, CullPattern=equals_2.Equality)
division_20 = Division(A=addition_10, B=2)
strip_width = Number(width_strips_3)
pt_26 = ConstructPoint(XCoordinate=division_20, YCoordinate=dedomain_3.Start, ZCoordinate=0)
addition_11 = Addition(A=strip_width, B=Slider(0.01, range=0..0.01))
lng_9 = ListLength(List=flatten(stripboundaries))
series_11 = Series(Start=Slider(10, range=0..10), Step=addition_11, Count=lng_9)
unflatten = UnflattenTree(Tree=series_11, Guide=stripboundaries)
pt_27 = ConstructPoint(XCoordinate=unflatten, YCoordinate=0, ZCoordinate=0)
vec2pt = Vector2Pt(PointA=pt_26, PointB=pt_27, Unitize=False)  # -> Vector, Length
number_slider_28 = Slider(0.08, range=0..0.1)
move_28 = Move(Geometry=cull_13, Motion=vec2pt.Vector)  # -> Geometry, Transform
number_slider_29 = Slider(1000, range=0..1000)
neg_20 = Negative(Value=number_slider_28)
move_29 = Move(Geometry=stripboundaries, Motion=vec2pt.Vector)  # -> Geometry, Transform
xy_7 = XYPlane(Origin=move_28.Geometry)
multiplication_11 = Multiplication(A=subtraction_16, B=number_slider_29)
round_5 = Round(Number=multiplication_11)  # -> Nearest, Floor, Ceiling
area = Area(Geometry=move_29.Geometry)  # -> Area, Centroid
division_21 = Division(A=round_5.Nearest, B=number_slider_29)
concat = Concatenate(FragmentA=round_5.Nearest, FragmentB="mm")
cir = Circle(Plane=xy_7, Radius=bolt_hole_radius_2)
boundaries = Curve(move_29.Geometry)

# ----
# Boundary Fabrication Drawings
number_slider_30 = Slider(5, range=0..10)
boundary_curve_1 = Curve(join)
base_planes_angles_2 = Rectangle(rotate_12.Geometry)
boundary_faster_hole_diameter_2 = Number(boundary_faster_hole_diameter)
fastener_points = Point(cull_10)
neg_21 = Negative(Value=number_slider_30)
base_planes_angles_3 = Rectangle(simplify(base_planes_angles_2))
area_2 = Area(Geometry=boundary_curve_1)  # -> Area, Centroid
pt_28 = ConstructPoint(XCoordinate=0, YCoordinate=neg_21, ZCoordinate=0)
division_22 = Division(A=boundary_faster_hole_diameter_2, B=2)
pln_4 = Plane(base_planes_angles_3)
vec2pt_2 = Vector2Pt(PointA=area_2.Centroid, PointB=pt_28, Unitize=False)  # -> Vector, Length
pt_29 = Point(pln_4)
incurve_3 = PointInCurve(Point=pt_29, Curve=boundary_curve_1)  # -> Relationship, Point
cir_2 = Circle(Plane=fastener_points, Radius=division_22)
equals_3 = Equality(FirstNumber=incurve_3.Relationship, SecondNumber=Slider(2, range=0..10))  # -> simplify(Equality), Inequality
cull_14 = CullPattern(List=pt_29, CullPattern=equals_3.Equality)
cull_15 = CullPattern(List=base_planes_angles_3, CullPattern=equals_3.Equality)
move_30 = Move(Geometry=cir_2, Motion=vec2pt_2.Vector)  # -> Geometry, Transform
move_31 = Move(Geometry=boundary_curve_1, Motion=vec2pt_2.Vector)  # -> Geometry, Transform

lng_10 = ListLength(List=merge_21)
multiplication_12 = Multiplication(A=lng_10, B=Slider(8, range=0..10))
incurve_4 = PointInCurve(Point=pt_14, Curve=boundary_curve_1)  # -> Relationship, Point
equals_4 = Equality(FirstNumber=incurve_4.Relationship, SecondNumber=Slider(2, range=0..10))  # -> simplify(Equality), Inequality
cull_16 = CullPattern(List=pt_14, CullPattern=equals_4.Equality)  # -> simplify(List)
cull_17 = CullPattern(List=base_planes_angles, CullPattern=equals_4.Equality)
trim_5 = TrimTree(Tree=cull_14, Depth=1)
trim_6 = TrimTree(Tree=cull_17, Depth=1)
trim_7 = TrimTree(Tree=cull_15, Depth=1)
trim_8 = TrimTree(Tree=cull_16, Depth=1)
c_script_12 = CSharpScript(x=trim_8, suf="S")  # -> out, flatten(A); inputs x: tree, suf: String
# ---------- c_script_12: C# ----------
    DataTree<string> name = new DataTree<string>();

    for (int i = 0; i < x.BranchCount; i++)
    {
      GH_Path path = new GH_Path(i);

      for (int j = 0; j < x.Branch(i).Count; j++)
      {
        name.Add((i+1).ToString() + suf, path);
      }


    }

    A = name;
# ---------- end c_script_12 ----------
c_script_13 = CSharpScript(x=trim_5, suf="E")  # -> out, A; inputs x: tree, suf: String; same code as c_script_12
move_32 = Move(Geometry=trim_6, Motion=vec2pt_2.Vector)  # -> Geometry, Transform
move_33 = Move(Geometry=flatten(trim_8), Motion=vec2pt_2.Vector)  # -> Geometry, Transform
null_2 = NullItem(Item=move_33.Geometry)  # -> NullFlags, InvalidFlags, Description
pdecon_10 = Deconstruct(Point=move_28.Geometry)  # -> XComponent, YComponent, ZComponent
bnd = Bounds(Numbers=pdecon_10.YComponent)
dedomain_5 = DeconstructDomain(Domain=bnd)  # -> Start, End
addition_12 = Addition(A=number_slider_28, B=dedomain_5.Start)
strip_segment_names_2 = Text(strip_segment_names)
holes = Curve(cir)

move_34 = Move(Geometry=trim_5, Motion=vec2pt_2.Vector)  # -> Geometry, Transform
move_35 = Move(Geometry=trim_7, Motion=vec2pt_2.Vector)  # -> Geometry, Transform
cull_18 = CullPattern(List=move_33.Geometry, CullPattern=invert(null_2.NullFlags))
tag_5 = TextTag3D(Location=cull_18, Text=c_script_12.A, Size=number_slider_17, Colour=swatch_2, Justification=8)

tag_6 = TextTag3D(Location=move_34.Geometry, Text=c_script_13.A, Size=number_slider_17, Justification=8)

pt_30 = ConstructPoint(XCoordinate=unflatten, YCoordinate=addition_12, ZCoordinate=0)
tag_7 = TextTag3D(Location=area.Centroid, Text=graft(strip_segment_names_2), Size=Slider(0.025, range=0..0.1), Justification=5)

pl_8 = ConstructPlane(Origin=pt_30, XAxis=Y, YAxis=neg_16)

tag_8 = TextTag3D(Location=pl_8, Text=concat, Size=Slider(0.01, range=0..0.01), Colour=swatch_2, Justification=4)

# ==== cluster Cluster
endangle = ClusterInput()
N = ClusterInput()
A = ClusterInput()
A_2 = ClusterInput()
posneg = ClusterInput()
startangle = ClusterInput()
crv = ClusterInput()
crv_2 = Curve(reparameterize(graft(crv)))
srf = ClusterInput()
posneg_2 = Number(posneg)
divide = DivideCurve(Curve=crv_2, Count=N, Kinks=False)  # -> Points, Tangents, Parameters
endangle_2 = Number(graft(endangle))
startangle_2 = Number(startangle)
srf_2 = Surface(simplify(srf))
pt = Point(divide.Points)
crv_cp = CurveClosestPoint(Point=pt, Curve=crv_2)  # -> Point, Parameter, Distance
eval = EvaluateCurve(Curve=crv_2, Parameter=crv_cp.Parameter)  # -> Point, Tangent, Angle
srf_cp = SurfaceClosestPoint(Point=eval.Point, Surface=srf_2)  # -> Point, UVPoint, Distance
evalsrf = EvaluateSurface(Surface=srf_2, Point=srf_cp.UVPoint)  # -> Point, Normal, Frame
xprod = CrossProduct(VectorA=eval.Tangent, VectorB=evalsrf.Normal, Unitize=False)  # -> Vector, Length
pl = ConstructPlane(Origin=eval.Point, XAxis=xprod.Vector, YAxis=evalsrf.Normal)
extrude_sections = ExtrudeSections(srf=srf_2, startangle=startangle_2, endangle=endangle_2, pln=pl, A=A_2, A_2=A, posneg=posneg_2)  # -> flatten(L)
L = ClusterOutput(extrude_sections)

# ==== cluster ExtrudeSections
endangle = ClusterInput()
startangle = ClusterInput()
pln = ClusterInput()
srf = ClusterInput()
srf_2 = Surface(srf)
endangle_2 = Number(graft(endangle))
startangle_2 = Number(graft(startangle))
pln_2 = Plane(simplify(pln))
lng = ListLength(List=pln_2)
A = ClusterInput()
A_2 = ClusterInput()
subtraction = Subtraction(A=lng, B=1)
number_slider = Slider(0, range=0..100)
posneg = ClusterInput()
division = Division(A=A, B=2)
division_2 = Division(A=A_2, B=2)
neg = Negative(Value=division)
posneg_2 = Number(graft(posneg))
neg_2 = Negative(Value=division_2)
item = ListItem(List=pln_2, Index=number_slider, Wrap=True)
division_3 = Division(A=division_2, B=Slider(2, range=0..10))
item_2 = ListItem(List=pln_2, Index=subtraction, Wrap=True)
multiplication = Multiplication(A=division_3, B=posneg_2)
panel = Panel(startangle_2)
pt = Point(item)
addition = Addition(A=neg_2, B=multiplication)
pt_2 = Point(item_2)
addition_2 = Addition(A=division_2, B=multiplication)
panel_2 = Panel(posneg_2)
srf_cp = SurfaceClosestPoint(Point=pt, Surface=srf_2)  # -> Point, UVPoint, Distance
dom = ConstructDomain(DomainStart=neg, DomainEnd=division)
dom_2 = ConstructDomain(DomainStart=addition, DomainEnd=addition_2)
srf_cp_2 = SurfaceClosestPoint(Point=pt_2, Surface=srf_2)  # -> Point, UVPoint, Distance
evalsrf = EvaluateSurface(Surface=srf_2, Point=srf_cp.UVPoint)  # -> Point, Normal, Frame
evalsrf_2 = EvaluateSurface(Surface=srf_2, Point=srf_cp_2.UVPoint)  # -> Point, Normal, Frame
rotate = Rotate(Geometry=item_2, Angle=endangle_2, Plane=evalsrf_2.Frame)  # -> Geometry, Transform
rotate_2 = Rotate(Geometry=item, Angle=startangle_2, Plane=evalsrf.Frame)  # -> Geometry, Transform
replace = ReplaceItems(List=pln_2, Item=rotate_2.Geometry, Indices=number_slider, Wrap=False)
replace_2 = ReplaceItems(List=replace, Item=rotate.Geometry, Indices=subtraction, Wrap=False)
rectangle = Rectangle(Plane=replace_2, XSize=dom, YSize=dom_2, Radius=0)  # -> Rectangle, Length
loft = Loft(
    Curves=rectangle.Rectangle,
    Options={Adjust=False, Closed=False, LoftEnds=0, LoftSimp=0, LoftType=0, Rebuild=10, Refit=0.01})
panel_3 = Panel(rectangle.Rectangle)
L = ClusterOutput(loft)
